# Grasshopper definition 3DPrint.gh (Grasshopper 1.0.7)

# ---- group: RH_IN:radius
number_slider = Slider(3, range=0..5)

# ---- group: RH_IN:3dprint
boolean = Boolean(False)

# ---- group: RH_IN:density
number_slider_2 = Slider(8, range=0..50)

# ---- group: RH_INPUT:height
number_slider_3 = Slider(100, range=80..100)

# ---- group: RH_IN:rotate
number_slider_4 = Slider(128, range=0..360)

# ----
circle = Circle(Plane=PlaneXY(0, 0, 0), Radius=number_slider)
offset_curve = OffsetCurve(Curve=circle, Distance=Slider(2, range=0..5), Plane=PlaneXY(0, 0, 0), Corners=1)
divide_curve = DivideCurve(Curve=circle, Count=number_slider_2, Kinks=False)  # -> Points, Tangents, Parameters
divide_curve_2 = DivideCurve(Curve=offset_curve, Count=number_slider_2, Kinks=False)  # -> Points, Tangents, Parameters
dispatch = Dispatch(List=divide_curve.Points, DispatchPattern=[True, False])  # -> ListA, ListB
dispatch_2 = Dispatch(List=divide_curve_2.Points, DispatchPattern=[True, False])  # -> ListA, ListB
number_slider_5 = Slider(0.1, range=0..0.1)
point = Point(dispatch.ListA)
point_2 = Point(dispatch_2.ListA)
weave = Weave(Pattern=[0, 1], Stream0=point, Stream1=point_2, NullGaps=False)
series = Series(Start=0, Step=number_slider_5, Count=number_slider_3)
nurbs_curve = NurbsCurve(Vertices=weave, Degree=3, Periodic=True)  # -> Curve, Length, Domain
unit_z = UnitZ(Factor=series)
move = Move(Geometry=nurbs_curve.Curve, Motion=unit_z)  # -> Geometry, Transform
construct_domain = ConstructDomain(DomainStart=number_slider_4, DomainEnd=Slider(360, range=0..360))
area = Area(Geometry=move.Geometry)  # -> Area, Centroid
range = Range(Domain=construct_domain, Steps=number_slider_3)
radians = Radians(Degrees=range)
range_2 = Range(Domain=Domain(0, 1), Steps=number_slider_3)
rotate = Rotate(Geometry=move.Geometry, Angle=radians, Plane=area.Centroid)  # -> Geometry, Transform
graph_mapper = GraphMapper(
    range_2,
    x0=0,
    x1=1,
    y0=0,
    y1=1,
    Ox=0.5613606572,
    Oy=0.1491526961,
    Px=0.6899715066,
    Py=0.2038118839,
    container_name="Parabola")
multiplication = Multiplication(A=graph_mapper, B=Slider(0.84, range=0..5))
scale = Scale(Geometry=rotate.Geometry, Center=area.Centroid, Factor=multiplication)  # -> Geometry, Transform
data_dam = DataDam(DataDataA=scale.Geometry, BufferDelay=10000000, BufferMode=0)
pipe = Pipe(Curve=scale.Geometry, Radius=number_slider_5, Caps=0)
custom_preview = CustomPreview(Geometry=pipe, Material=ColourSwatch(SwatchColor=RGB(145, 141, 141)))

jagged = SettingsSpeed()
mesh_brep = MeshBrep(Brep=pipe, Settings=jagged)
mesh_colours = MeshColours(Mesh=flatten(pipe), Colours=ColourSwatch(SwatchColor=RGB(0, 132, 255)))

construct_point = ConstructPoint(XCoordinate=0, YCoordinate=0, ZCoordinate=0)
number_slider_6 = Slider(12, range=0..100)
line_sdl = LineSDL(Start=construct_point, Direction=Vector(0, 0, 1), Length=Slider(10, range=1..10))
range_3 = Range(Domain=Domain(0, 1), Steps=number_slider_6)
divide_curve_3 = DivideCurve(Curve=line_sdl, Count=number_slider_6, Kinks=False)  # -> Points, Tangents, Parameters
graph_mapper_2 = GraphMapper(
    range_3,
    x0=0,
    x1=1,
    y0=0,
    y1=1,
    container_name="Bezier",
    cpx=[0, 0.379699707, 0.75, 1],
    cpy=[0.1616361141, 0.6912076473, 0.75, 0.2995919585])
multiplication_2 = Multiplication(A=graph_mapper_2, B=Slider(12, range=0..100))
circle_cnr = CircleCNR(Center=divide_curve_3.Points, Normal=Vector(0, 0, 1), Radius=multiplication_2)
multiplication_3 = Multiplication(A=graph_mapper_2, B=Slider(0.6, range=0..1))
seam = Seam(Curve=reparameterize(circle_cnr), Seam=multiplication_3)
number_slider_7 = Slider(12, range=0..100)
divide_curve_4 = DivideCurve(Curve=seam, Count=number_slider_7, Kinks=False)  # -> Points, Tangents, Parameters
series_2 = Series(Start=0, Step=number_slider_7, Count=number_slider_6)
dispatch_3 = Dispatch(List=divide_curve_4.Points, DispatchPattern=[True, False])  # -> ListA, ListB
series_3 = Series(Start=series_2, Step=1, Count=number_slider_7)
vector_2pt = Vector2Pt(PointA=dispatch_3.ListB, PointB=graft(divide_curve_3.Points), Unitize=False)  # -> Vector, Length
shift_list = ShiftList(List=series_3, Shift=1, Wrap=True)
multiplication_4 = Multiplication(A=vector_2pt.Vector, B=Slider(0.2, range=0..1))
addition = Addition(A=shift_list, B=number_slider_7)
addition_2 = Addition(A=series_3, B=number_slider_7)
move_2 = Move(Geometry=dispatch_3.ListB, Motion=multiplication_4)  # -> Geometry, Transform
series_4 = Series(Start=0, Step=1, Count=number_slider_7)
weave_2 = Weave(Pattern=[0, 1], Stream0=dispatch_3.ListA, Stream1=move_2.Geometry, NullGaps=False)
shift_list_2 = ShiftList(List=series_4, Shift=1, Wrap=True)
flatten_tree = FlattenTree(Tree=weave_2, Path="{0}")
list_length = ListLength(List=flatten_tree)
mesh_quad = MeshQuad(CornerA=shift_list, CornerB=series_3, CornerC=addition, CornerD=addition_2)
mesh_triangle = MeshTriangle(CornerA=series_4, CornerB=list_length, CornerC=shift_list_2)
merge = Merge(Data1=flatten_tree, Data2=construct_point)
merge_2 = Merge(Data1=mesh_quad, Data2=mesh_triangle)
construct_mesh = ConstructMesh(Vertices=merge, Faces=flatten(merge_2))

loft = Loft(Curves=scale.Geometry, Options={Adjust=False, Closed=False, LoftEnds=0, LoftSimp=0, LoftType=0, Rebuild=10, Refit=0.01})
mesh_brep_2 = MeshBrep(
    Brep=loft,
    Settings=flatten({GridMaxCount=0, GridMinCount=16, JaggedSeams=False, MaxEdgeLength=0, MinEdgeLength=0.0001, MinTolerance=0, Refine=True, RefineAngle=0, RelativeTolerance=0.65, SimplePlanes=True, Tolerance=0}))
mesh_edges = MeshEdges(Mesh=mesh_brep_2)  # -> NakedEdges, InteriorEdges, NonManifoldEdges

stream_filter = StreamFilter(Gate=boolean, Stream0=mesh_brep_2, Stream1=mesh_brep)
M = MeshToBase64Draco(mesh=stream_filter)  # -> base64Draco; inputs mesh: Mesh
# ---------- M: C# ----------
    var options = new Rhino.FileIO.DracoCompressionOptions();
    options.CompressionLevel = 5;
    options.IncludeTextureCoordinates = false;
    options.IncludeVertexColors = false;

    var compressed = Rhino.FileIO.DracoCompression.Compress(mesh, options);
    base64Draco = compressed.ToBase64String();
# ---------- end M ----------

mesh = Mesh(stream_filter)

# ---- group: RH_OUT:meshb64
txt = Text(M)
